# Grasshopper definition phius_rv2024_simulate_ADORB.gh (Grasshopper 1.0.8)

# ----
# Source and Target Files / Folders
config = HBConfig()  # -> python_exe, py_lib_install, rad_install, os_install, ep_install, hb_os_gem, standards, asset_report, default_sim; plug-in component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
ghpython_script = GhPythonScript(hb_py_lib_install=config.py_lib_install)  # -> out, measure
# ---------- ghpython_script: Python ----------
import os 


measure_ = os.path.join(_hb_py_lib_install, "honeybee_revive_measures", "set_revive_people_eplus/")
# ---------- end ghpython_script ----------
ghpython_script_2 = GhPythonScript()  # -> out, root_folder, source_weather_folder, hbrv_weather_folder, hbrv_source_model, port, hbrv_winter, hbrv_summer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
# ---------- ghpython_script_2: Python ----------
import os 
import rhinoscriptsyntax as rs

root_folder_ = rs.DocumentPath()
source_weather_folder_ = os.path.join(root_folder_, "_source_weather")

adorb_folder_ = os.path.join(root_folder_, "adorb")

hbrv_weather_folder_ = os.path.join(adorb_folder_, "hbrv_generated_weather")
source_model_dir_ = os.path.join(adorb_folder_, "_source_models")
hbrv_source_model_ = os.path.join(root_folder_, "phius_rv2024_model.hbjson")

hbrv_winter_ = os.path.join(adorb_folder_, "winter", "hbrv")
hbrv_summer_ = os.path.join(adorb_folder_, "summer", "hbrv")

phius_winter_ = os.path.join(adorb_folder_, "winter", "phius_gui")
phius_summer_ = os.path.join(adorb_folder_, "summer", "phius_gui")
# ---------- end ghpython_script_2 ----------
entwine = Entwine(Branch00=simplify(ghpython_script_2.hbrv_winter), Branch01=simplify(ghpython_script_2.hbrv_summer), FlattenInputs=True)
entwine_2 = Entwine(Branch00=simplify(ghpython_script_2.phius_winter), Branch01=simplify(ghpython_script_2.phius_summer), FlattenInputs=True)
phius_gui_reference_model_output_folders = Panel(entwine_2)
weather_save_folder = Panel(ghpython_script_2.hbrv_weather_folder)
measure_folder = Panel(ghpython_script.measure)
weather_save_folder_2 = Panel(ghpython_script_2.source_weather_folder)
hbjson_source_model = Panel(ghpython_script_2.hbrv_source_model)
hb_rv_model_output_folders = Panel(entwine)

# ----
# Phius REVIVE 2024 Test Model
boolean_toggle = BooleanToggle(True)
loadobjects = HBLoadObjects(hb_file=hbjson_source_model, load=boolean_toggle)  # -> out, hb_objs; plug-in component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
ghpython_script_3 = GhPythonScript(model=loadobjects.hb_objs)  # -> out, rooms
# ---------- ghpython_script_3: Python ----------
rooms_ = _model.rooms
# ---------- end ghpython_script_3 ----------

# ----
# REVIVE | HVAC
panel = Panel("GasFurnaceDXAC")
create_revive_hvac_equipment_properties = HBREVIVECreateREVIVEHVACEquipmentProperties(name=panel, cost="7500", labor_fraction="0.4", lifetime_years="20")  # -> out, hvac_equipment_properties; inputs lifetime_years: Int32
# ---------- create_revive_hvac_equipment_properties: Python ----------
#
# Honeybee-REVIVE: A Plugin for calculating Phius REVIVE using LadybugTools Honeybee-Energy Models
# 
# This component is part of the PH-Tools toolkit <https://github.com/PH-Tools>.
# 
# Copyright (c) 2024, PH-Tools and bldgtyp, llc <phtools@bldgtyp.com> 
# Honeybee-REVIVE is free software; you can redistribute it and/or modify 
# it under the terms of the GNU General Public License as published 
# by the Free Software Foundation; either version 3 of the License, 
# or (at your option) any later version. 
# 
# Honeybee-REVIVE is distributed in the hope that it will be useful,
# but WITHOUT ANY WARRANTY; without even the implied warranty of 
# MERCHANTABILITY or FITNESS FOR A PARTICULAR PURPOSE. See the 
# GNU General Public License for more details.
# 
# For a copy of the GNU General Public License
# see <https://github.com/PH-Tools/honeybee_revive/blob/main/LICENSE>.
# 
# @license GPL-3.0+ <http://spdx.org/licenses/GPL-3.0+>
#
"""
Create a new Phius-REVIVE-HVAC-Equipment-Properties item which can be added to a Honeybee-Room.
Note that this equipment is ONLY for keeping track of the relevant Phius-REVIVE
properties and does NOT add any actual equipment to the Honeybee-Rooms. Use the normal 
Honeybee-Energy components to configure the actual equipment objects on the roonms.
-
EM October 1, 2024
    Args:
        _name: (str) A name for the piece of REVIVE-HVAC-Equipment-Properties.

        _cost: (float) The total purchase-cost of the Appliance.

        _labor_fraction: (float) A number between 0 and 1.0 representing the percentage
            of the appliance cost related to labor, as opposed to material. 

        _lifetime_years: (float) The total number of years the appliance will last
            before it needs to be completely replaced. 

    Returns:
        hvac_equipment_properties_: (Process) The Honeybee-REVIVE-HVAC-Properties which can be added
            a Honeybee-Room.
"""

import scriptcontext as sc
import Rhino as rh
import rhinoscriptsyntax as rs
import ghpythonlib.components as ghc
import Grasshopper as gh

try:
    from ph_gh_component_io import gh_io
except ImportError as e:
    raise ImportError('\nFailed to import ph_gh_component_io:\n\t{}'.format(e))

try:
    from honeybee_revive_rhino import gh_compo_io
except ImportError as e:
    raise ImportError('\nFailed to import honeybee_revive_rhino:\n\t{}'.format(e))


# ------------------------------------------------------------------------------
import honeybee_revive_rhino._component_info_
reload(honeybee_revive_rhino._component_info_)
ghenv.Component.Name = "HB-REVIVE - Create REVIVE HVAC Equipment Properties"
DEV = honeybee_revive_rhino._component_info_.set_component_params(ghenv, dev=False)
if DEV:
    from honeybee_revive_rhino.gh_compo_io.equipment import hvac_create_properties as gh_compo_io
    reload(gh_compo_io)
    
# ------------------------------------------------------------------------------
# -- GH Interface
IGH = gh_io.IGH( ghdoc, ghenv, sc, rh, rs, ghc, gh )

# ------------------------------------------------------------------------------
gh_compo_interface = gh_compo_io.GHCompo_CreateReviveHvacEquipmentProperties(
        IGH,
        _name,
        _cost,
        _labor_fraction,
        _lifetime_years,
)
hvac_equipment_properties_ = gh_compo_interface.run()
print hvac_equipment_properties_
# ---------- end create_revive_hvac_equipment_properties ----------
add_revive_hvac_equipment_properties_to = HBREVIVEAddREVIVEHVACEquipmentPropertiesToRooms(
    equipment_properties=flatten(create_revive_hvac_equipment_properties.hvac_equipment_properties),
    hb_rooms=flatten(ghpython_script_3.rooms))  # -> out, hb_rooms; "Add REVIVE HVAC Equipment Properties to Rooms"; inputs equipment_properties: list, hb_rooms: list
# ---------- add_revive_hvac_equipment_properties_to: Python ----------
#
# Honeybee-REVIVE: A Plugin for calculating Phius REVIVE using LadybugTools Honeybee-Energy Models
# 
# This component is part of the PH-Tools toolkit <https://github.com/PH-Tools>.
# 
# Copyright (c) 2024, PH-Tools and bldgtyp, llc <phtools@bldgtyp.com> 
# Honeybee-REVIVE is free software; you can redistribute it and/or modify 
# it under the terms of the GNU General Public License as published 
# by the Free Software Foundation; either version 3 of the License, 
# or (at your option) any later version. 
# 
# Honeybee-REVIVE is distributed in the hope that it will be useful,
# but WITHOUT ANY WARRANTY; without even the implied warranty of 
# MERCHANTABILITY or FITNESS FOR A PARTICULAR PURPOSE. See the 
# GNU General Public License for more details.
# 
# For a copy of the GNU General Public License
# see <https://github.com/PH-Tools/honeybee_revive/blob/main/LICENSE>.
# 
# @license GPL-3.0+ <http://spdx.org/licenses/GPL-3.0+>
#
"""
Add Phius-REVIVE-HVAC-Equipment-Properties onto Honeybee-Rooms.
-
EM October 1, 2024
    Args:
        _equipment_properties: (list[]) The new Phius-REVIVE-HVAC-Equiment-Properties
            to add to the Honeybee-Rooms.

        _hb_rooms: (list[Room]) The Honeybee-Rooms to add the new Phius-REVIVE
            HVAC-Properties to.

    Returns:
        hb_rooms_: (list[Room]) The Honeybee-Rooms with the Phius-REVIVE HVAC
            Equipment Properties added. 
"""

import scriptcontext as sc
import Rhino as rh
import rhinoscriptsyntax as rs
import ghpythonlib.components as ghc
import Grasshopper as gh

try:
    from ph_gh_component_io import gh_io
except ImportError as e:
    raise ImportError('\nFailed to import ph_gh_component_io:\n\t{}'.format(e))

try:
    from honeybee_revive_rhino import gh_compo_io
except ImportError as e:
    raise ImportError('\nFailed to import honeybee_revive_rhino:\n\t{}'.format(e))


# ------------------------------------------------------------------------------
import honeybee_revive_rhino._component_info_
reload(honeybee_revive_rhino._component_info_)
ghenv.Component.Name = "HB-REVIVE - Add REVIVE HVAC Equipment Properties to Rooms"
DEV = honeybee_revive_rhino._component_info_.set_component_params(ghenv, dev=False)
if DEV:
    from honeybee_revive_rhino.gh_compo_io.equipment import hvac_add_properties_to_room as gh_compo_io
    reload(gh_compo_io)
    
# ------------------------------------------------------------------------------
# -- GH Interface
IGH = gh_io.IGH( ghdoc, ghenv, sc, rh, rs, ghc, gh )

# ------------------------------------------------------------------------------
gh_compo_interface = gh_compo_io.GHCompo_AddHvacEquipmentPropertiesToRooms(
        IGH,
        _equipment_properties,
        _hb_rooms,
)
hb_rooms_ = gh_compo_interface.run()
print hb_rooms_
# ---------- end add_revive_hvac_equipment_properties_to ----------

# ----
# REVIVE | Appliances
panel_2 = Panel("1")
constantschedule = HBConstantSchedule(values=panel_2)  # -> out, schedule, idf_text; plug-in component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
create_revive_appliance = HBREVIVECreateREVIVEAppliance(
    name="Range_0W",
    watts="0",
    schedule=constantschedule.schedule,
    fuel_type="Electricity",
    use_category="Range",
    radiant_fract="0.4",
    latent_fract="0.3")  # -> out, appliance
# ---------- create_revive_appliance: Python ----------
#
# Honeybee-REVIVE: A Plugin for calculating Phius REVIVE using LadybugTools Honeybee-Energy Models
# 
# This component is part of the PH-Tools toolkit <https://github.com/PH-Tools>.
# 
# Copyright (c) 2024, PH-Tools and bldgtyp, llc <phtools@bldgtyp.com> 
# Honeybee-REVIVE is free software; you can redistribute it and/or modify 
# it under the terms of the GNU General Public License as published 
# by the Free Software Foundation; either version 3 of the License, 
# or (at your option) any later version. 
# 
# Honeybee-REVIVE is distributed in the hope that it will be useful,
# but WITHOUT ANY WARRANTY; without even the implied warranty of 
# MERCHANTABILITY or FITNESS FOR A PARTICULAR PURPOSE. See the 
# GNU General Public License for more details.
# 
# For a copy of the GNU General Public License
# see <https://github.com/PH-Tools/honeybee_revive/blob/main/LICENSE>.
# 
# @license GPL-3.0+ <http://spdx.org/licenses/GPL-3.0+>
#
"""
Create a new Honeybee-REVIVE Appliance which can be added to one or more Honeybee-Rooms.
-
EM October 1, 2024
    Args:
        _name_: (str) Text to set the name for the Appliance and to be incorporated into a
            unique Appliance identifier. If None, a unique name will be
            generated.
        
        _watts: (float) A number for the process load power in Watts.
        
        _schedule: A fractional schedule for the use of the process over the course of
            the year. The fractional values will get multiplied by the _watts
            to yield a complete process load profile.
        
        _fuel_type: (str) Text to denote the type of fuel consumed by the Appliance. Using the
            "None" type indicates that no end uses will be associated with the
            Appliance, only the zone gains. Choose from the following.
                * Electricity
                * NaturalGas
                * Propane
                * FuelOilNo1
                * FuelOilNo2
                * Diesel
                * Gasoline
                * Coal
                * Steam
                * DistrictHeating
                * DistrictCooling
                * OtherFuel1
                * OtherFuel2
                * None
        
        use_category_: Text to indicate the end-use subcategory, which will identify
            the appliance load in the EUI output. For example, “Cooking”,
            “Clothes Drying”, etc. (Default: General).
        
        radiant_fract_: A number between 0 and 1 for the fraction of the total
            appliance load given off as long wave radiant heat. (Default: 0).
        
        latent_fract_: A number between 0 and 1 for the fraction of the total
            appliance load that is latent (as opposed to sensible). (Default: 0).
        
        lost_fract_: A number between 0 and 1 for the fraction of the total
            appliance load that is lost outside of the zone and the HVAC system.
            Typically, this is used to represent heat that is exhausted directly
            out of a zone (as you would for a stove). (Default: 0).

    Returns:
        appliance_: (Process) The new Honeybee-REVIVE Appliance which can be added
            to one or more Honeybee-Rooms.
"""

import scriptcontext as sc
import Rhino as rh
import rhinoscriptsyntax as rs
import ghpythonlib.components as ghc
import Grasshopper as gh

try:
    from ph_gh_component_io import gh_io
except ImportError as e:
    raise ImportError('\nFailed to import ph_gh_component_io:\n\t{}'.format(e))

try:
    from honeybee_revive_rhino import gh_compo_io
except ImportError as e:
    raise ImportError('\nFailed to import honeybee_revive_rhino:\n\t{}'.format(e))


# ------------------------------------------------------------------------------
import honeybee_revive_rhino._component_info_
reload(honeybee_revive_rhino._component_info_)
ghenv.Component.Name = "HB-REVIVE - Create REVIVE Appliance"
DEV = honeybee_revive_rhino._component_info_.set_component_params(ghenv, dev=False)
if DEV:
    from honeybee_revive_rhino.gh_compo_io.equipment import appliances_create as gh_compo_io
    reload(gh_compo_io)
    
# ------------------------------------------------------------------------------
# -- GH Interface
IGH = gh_io.IGH( ghdoc, ghenv, sc, rh, rs, ghc, gh )

# ------------------------------------------------------------------------------
gh_compo_interface = gh_compo_io.GHCompo_CreateReviveAppliance(
        IGH,
        _name_,
        _watts,
        _schedule,
        _fuel_type,
        use_category_,
        radiant_fract_,
        latent_fract_,
        lost_fract_,
)
appliance_ = gh_compo_interface.run()
print appliance_
# ---------- end create_revive_appliance ----------
panel_3 = Panel("""Fridge_360W
Clotheswasher_160W
Clothesdryer_704W
Dishwasher_360W""")
load_revive_appliance_from_standards_lib = HBREVIVELoadREVIVEApplianceFromStandardsLibrary(appliance_names=panel_3)  # -> out, appliances; "Load REVIVE Appliance from Standards Library"; inputs appliance_names: list
# ---------- load_revive_appliance_from_standards_lib: Python ----------
#
# Honeybee-REVIVE: A Plugin for calculating Phius REVIVE using LadybugTools Honeybee-Energy Models
# 
# This component is part of the PH-Tools toolkit <https://github.com/PH-Tools>.
# 
# Copyright (c) 2024, PH-Tools and bldgtyp, llc <phtools@bldgtyp.com> 
# Honeybee-REVIVE is free software; you can redistribute it and/or modify 
# it under the terms of the GNU General Public License as published 
# by the Free Software Foundation; either version 3 of the License, 
# or (at your option) any later version. 
# 
# Honeybee-REVIVE is distributed in the hope that it will be useful,
# but WITHOUT ANY WARRANTY; without even the implied warranty of 
# MERCHANTABILITY or FITNESS FOR A PARTICULAR PURPOSE. See the 
# GNU General Public License for more details.
# 
# For a copy of the GNU General Public License
# see <https://github.com/PH-Tools/honeybee_revive/blob/main/LICENSE>.
# 
# @license GPL-3.0+ <http://spdx.org/licenses/GPL-3.0+>
#
"""
Load one or more Hoenybee-REVIVE Appliances from the Standards Library.
-
EM October 1, 2024
    Args:
        _appliance_names: (list[str]) The name or names to search the Honeybee-REVIVE
            standards library for.

    Returns:
        appliances_: (list[Process]) The Honeybee-REVIVE Appliances found.
"""

import scriptcontext as sc
import Rhino as rh
import rhinoscriptsyntax as rs
import ghpythonlib.components as ghc
import Grasshopper as gh

try:
    from ph_gh_component_io import gh_io
except ImportError as e:
    raise ImportError('\nFailed to import ph_gh_component_io:\n\t{}'.format(e))

try:
    from honeybee_revive_rhino import gh_compo_io
except ImportError as e:
    raise ImportError('\nFailed to import honeybee_revive_rhino:\n\t{}'.format(e))


# ------------------------------------------------------------------------------
import honeybee_revive_rhino._component_info_
reload(honeybee_revive_rhino._component_info_)
ghenv.Component.Name = "HB-REVIVE - Load REVIVE Appliance from Standards Library"
DEV = honeybee_revive_rhino._component_info_.set_component_params(ghenv, dev=False)
if DEV:
    from honeybee_revive_rhino.gh_compo_io.standards import load_appliance_from_standards as gh_compo_io
    reload(gh_compo_io)
    
# ------------------------------------------------------------------------------
# -- GH Interface
IGH = gh_io.IGH( ghdoc, ghenv, sc, rh, rs, ghc, gh )

# ------------------------------------------------------------------------------
gh_compo_interface = gh_compo_io.GHCompo_LoadReviveApplianceFromStandardsLibrary(
        IGH,
        _appliance_names
)
appliances_ = gh_compo_interface.run()
for a in appliances_:
    print(a)
# ---------- end load_revive_appliance_from_standards_lib ----------
set_revive_appliance_properties = HBREVIVESetREVIVEApplianceProperties(cost="992", labor_fraction="0.1", lifetime_years="13", appliance=create_revive_appliance.appliance)  # -> out, appliance
# ---------- set_revive_appliance_properties: Python ----------
#
# Honeybee-REVIVE: A Plugin for calculating Phius REVIVE using LadybugTools Honeybee-Energy Models
# 
# This component is part of the PH-Tools toolkit <https://github.com/PH-Tools>.
# 
# Copyright (c) 2024, PH-Tools and bldgtyp, llc <phtools@bldgtyp.com> 
# Honeybee-REVIVE is free software; you can redistribute it and/or modify 
# it under the terms of the GNU General Public License as published 
# by the Free Software Foundation; either version 3 of the License, 
# or (at your option) any later version. 
# 
# Honeybee-REVIVE is distributed in the hope that it will be useful,
# but WITHOUT ANY WARRANTY; without even the implied warranty of 
# MERCHANTABILITY or FITNESS FOR A PARTICULAR PURPOSE. See the 
# GNU General Public License for more details.
# 
# For a copy of the GNU General Public License
# see <https://github.com/PH-Tools/honeybee_revive/blob/main/LICENSE>.
# 
# @license GPL-3.0+ <http://spdx.org/licenses/GPL-3.0+>
#
"""
Set the Honeybee-REVIVE properties on a Honeybee-REVIVE Appliance.
-
EM October 1, 2024
    Args:
        _cost: (float) The total purchase-cost of the Appliance.

        _labor_fraction: (float) A number between 0 and 1.0 representing the percentage
            of the appliance cost related to labor, as opposed to material. 

        _lifetime_years: (float) The total number of years the appliance will last
            before it needs to be completely replaced. 

        _appliance: (Process) The Hoenybee-REVIVE Appliance to set the properties on.

    Returns:
        appliance_: (Process) The Honeybee-REVIVE Appliance with the properties set.
"""

import scriptcontext as sc
import Rhino as rh
import rhinoscriptsyntax as rs
import ghpythonlib.components as ghc
import Grasshopper as gh

try:
    from ph_gh_component_io import gh_io
except ImportError as e:
    raise ImportError('\nFailed to import ph_gh_component_io:\n\t{}'.format(e))

try:
    from honeybee_revive_rhino import gh_compo_io
except ImportError as e:
    raise ImportError('\nFailed to import honeybee_revive_rhino:\n\t{}'.format(e))


# ------------------------------------------------------------------------------
import honeybee_revive_rhino._component_info_
reload(honeybee_revive_rhino._component_info_)
ghenv.Component.Name = "HB-REVIVE - Set REVIVE Appliance Properties"
DEV = honeybee_revive_rhino._component_info_.set_component_params(ghenv, dev=False)
if DEV:
    from honeybee_revive_rhino.gh_compo_io.equipment import appliances_set_revive_properties as gh_compo_io
    reload(gh_compo_io)
    
# ------------------------------------------------------------------------------
# -- GH Interface
IGH = gh_io.IGH( ghdoc, ghenv, sc, rh, rs, ghc, gh )

# ------------------------------------------------------------------------------
gh_compo_interface = gh_compo_io.GHCompo_SetApplianceReviveProperties(
        IGH,
        _cost,
        _labor_fraction,
        _lifetime_years,
        _appliance,
)
appliance_ = gh_compo_interface.run()
print appliance_
# ---------- end set_revive_appliance_properties ----------
merge = Merge(Data1=set_revive_appliance_properties.appliance, Data2=load_revive_appliance_from_standards_lib.appliances)
add_revive_appliances_to_rooms = HBREVIVEAddREVIVEAppliancesToRooms(appliances=merge, hb_rooms=add_revive_hvac_equipment_properties_to.hb_rooms)  # -> out, hb_rooms; inputs appliances: list, hb_rooms: list
# ---------- add_revive_appliances_to_rooms: Python ----------
#
# Honeybee-REVIVE: A Plugin for calculating Phius REVIVE using LadybugTools Honeybee-Energy Models
# 
# This component is part of the PH-Tools toolkit <https://github.com/PH-Tools>.
# 
# Copyright (c) 2024, PH-Tools and bldgtyp, llc <phtools@bldgtyp.com> 
# Honeybee-REVIVE is free software; you can redistribute it and/or modify 
# it under the terms of the GNU General Public License as published 
# by the Free Software Foundation; either version 3 of the License, 
# or (at your option) any later version. 
# 
# Honeybee-REVIVE is distributed in the hope that it will be useful,
# but WITHOUT ANY WARRANTY; without even the implied warranty of 
# MERCHANTABILITY or FITNESS FOR A PARTICULAR PURPOSE. See the 
# GNU General Public License for more details.
# 
# For a copy of the GNU General Public License
# see <https://github.com/PH-Tools/honeybee_revive/blob/main/LICENSE>.
# 
# @license GPL-3.0+ <http://spdx.org/licenses/GPL-3.0+>
#
"""
Add one or more Honeybee-REVIVE Appliances to a group of Honeybee-Rooms. 
NOTE that ALL of the appliances will be added to ALL of the rooms. So you 
may want to break out the rooms and assign the appliances separately (for instance
if you are assigning a Cooktop, be sure that this gets assigned only to one room.)
-
EM October 1, 2024
    Args:
        _appliances: (list[Process]) The appliances to add to each of the 
            Honeybee-Rooms

        _hb_rooms: (list[Room]) The Honeybee-Rooms to have the appliances added.

    Returns:
        hb_rooms_: (list[Room]) The Honeybee-Rooms with the Appliances added. 
"""

import scriptcontext as sc
import Rhino as rh
import rhinoscriptsyntax as rs
import ghpythonlib.components as ghc
import Grasshopper as gh

try:
    from ph_gh_component_io import gh_io
except ImportError as e:
    raise ImportError('\nFailed to import ph_gh_component_io:\n\t{}'.format(e))

try:
    from honeybee_revive_rhino import gh_compo_io
except ImportError as e:
    raise ImportError('\nFailed to import honeybee_revive_rhino:\n\t{}'.format(e))


# ------------------------------------------------------------------------------
import honeybee_revive_rhino._component_info_
reload(honeybee_revive_rhino._component_info_)
ghenv.Component.Name = "HB-REVIVE - Add REVIVE Appliances to Rooms"
DEV = honeybee_revive_rhino._component_info_.set_component_params(ghenv, dev=False)
if DEV:
    from honeybee_revive_rhino.gh_compo_io.equipment import appliances_add_to_room as gh_compo_io
    reload(gh_compo_io)
    
# ------------------------------------------------------------------------------
# -- GH Interface
IGH = gh_io.IGH( ghdoc, ghenv, sc, rh, rs, ghc, gh )

# ------------------------------------------------------------------------------
gh_compo_interface = gh_compo_io.GHCompo_AddReviveAppliancesToRooms(
        IGH,
        _appliances,
        _hb_rooms,
)
hb_rooms_ = gh_compo_interface.run()
# ---------- end add_revive_appliances_to_rooms ----------

# ---- group: Rooftop PV
# REVIVE | Shading & PV
# Until Chris merges the PR, this won’t work.
cluster = Cluster(hb_objs=add_revive_appliances_to_rooms.hb_rooms)  # disabled
shade = HBShade(geo=cluster)  # -> out, shades; disabled; plug-in component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
photovoltaic = HBPhotovoltaicProperties(shades=shade.shades)  # -> out, shades; disabled; plug-in component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
panel_4 = Panel("5")  # disabled
panel_5 = Panel("0.25")  # disabled
panel_6 = Panel("25")  # disabled
set_revive_pv_shade_properties = HBREVIVESetREVIVEPVShadeProperties(cost=panel_4, labor_fraction=panel_5, lifetime_years=panel_6, hb_shades=photovoltaic.shades)  # -> out, hb_shades; inputs lifetime_years: Int32, hb_shades: list; disabled
# ---------- set_revive_pv_shade_properties: Python ----------
#
# Honeybee-REVIVE: A Plugin for calculating Phius REVIVE using LadybugTools Honeybee-Energy Models
# 
# This component is part of the PH-Tools toolkit <https://github.com/PH-Tools>.
# 
# Copyright (c) 2024, PH-Tools and bldgtyp, llc <phtools@bldgtyp.com> 
# Honeybee-REVIVE is free software; you can redistribute it and/or modify 
# it under the terms of the GNU General Public License as published 
# by the Free Software Foundation; either version 3 of the License, 
# or (at your option) any later version. 
# 
# Honeybee-REVIVE is distributed in the hope that it will be useful,
# but WITHOUT ANY WARRANTY; without even the implied warranty of 
# MERCHANTABILITY or FITNESS FOR A PARTICULAR PURPOSE. See the 
# GNU General Public License for more details.
# 
# For a copy of the GNU General Public License
# see <https://github.com/PH-Tools/honeybee_revive/blob/main/LICENSE>.
# 
# @license GPL-3.0+ <http://spdx.org/licenses/GPL-3.0+>
#
"""
Add Phius-REVIVE properties to one or more Honeybee-Shade objects which have 
PV (Photovoltaic) panels on them. Note that you should use the Honeybee-Energy
'HB Photovoltaic Properties' component to set up the basic PV panel attributes
FIRST before using this componet to set the Phius-REVIVE properties.
-
EM October 1, 2024
    Args:
        _cost: (float) The total cost of the PV

        _labor_fraction: (float) The fraction of the PV cost associated with labor,
            as opposed to material.

        _lifetime_years: (float) The lifetime (in years) of the PV

        _hb_shades: (list[Shade]) A list of Honeybee-Energy Shade objects which 
            have PV-Modules added to them.

    Returns:
        hb_shades_: (list[Shade]) The Honeybee-Energy-Shade objects with their 
            Phius-REVIVE properties set. These Shades can be added to a Honeybee-Model.
"""

import scriptcontext as sc
import Rhino as rh
import rhinoscriptsyntax as rs
import ghpythonlib.components as ghc
import Grasshopper as gh

try:
    from ph_gh_component_io import gh_io
except ImportError as e:
    raise ImportError('\nFailed to import ph_gh_component_io:\n\t{}'.format(e))

try:
    from honeybee_revive_rhino import gh_compo_io
except ImportError as e:
    raise ImportError('\nFailed to import honeybee_revive_rhino:\n\t{}'.format(e))


# ------------------------------------------------------------------------------
import honeybee_revive_rhino._component_info_
reload(honeybee_revive_rhino._component_info_)
ghenv.Component.Name = "HB-REVIVE - Set REVIVE PV-Shade Properties"
DEV = honeybee_revive_rhino._component_info_.set_component_params(ghenv, dev=False)
if DEV:
    from honeybee_revive_rhino.gh_compo_io.equipment import pv_set_shade_properties as gh_compo_io
    reload(gh_compo_io)
    
# ------------------------------------------------------------------------------
# -- GH Interface
IGH = gh_io.IGH( ghdoc, ghenv, sc, rh, rs, ghc, gh )

# ------------------------------------------------------------------------------
gh_compo_interface = gh_compo_io.GHCompo_SetPvShadeProperties(
        IGH,
        _cost,
        _labor_fraction,
        _lifetime_years,
        _hb_shades,
)
hb_shades_ = gh_compo_interface.run()
# ---------- end set_revive_pv_shade_properties ----------

# ----
surface = Surface([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])
shade_2 = HBShade(geo=surface)  # -> out, shades; plug-in component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
merge_2 = Merge(Data1=shade_2.shades, Data2=shade.shades)

model = HBModel(rooms=flatten(add_revive_appliances_to_rooms.hb_rooms), shades=flatten(merge_2), name="revive_test_model")  # -> out, model; plug-in component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

# ----
# REVIVE | CO2 Measures
value_list = ValueList({"PERFORMANCE": "1-PERFORMANCE", "NON-PERFORMANCE": "2-NON_PERFORMANCE"}, selected="PERFORMANCE")
panel_7 = Panel("""HP Replace 1
HP Replace 2""")
load_revive_co2_measures_from_standards = HBREVIVELoadREVIVECO2MeasuresFromStandardsLibrary(measure_names=panel_7)  # -> out, measures; "Load REVIVE CO2-Measures from Standards Library"; inputs measure_names: list
#   port measure_names: (str) The name of the Measure to search the Standards library for.
# ---------- load_revive_co2_measures_from_standards: Python ----------
#
# Honeybee-REVIVE: A Plugin for calculating Phius REVIVE using LadybugTools Honeybee-Energy Models
# 
# This component is part of the PH-Tools toolkit <https://github.com/PH-Tools>.
# 
# Copyright (c) 2024, PH-Tools and bldgtyp, llc <phtools@bldgtyp.com> 
# Honeybee-REVIVE is free software; you can redistribute it and/or modify 
# it under the terms of the GNU General Public License as published 
# by the Free Software Foundation; either version 3 of the License, 
# or (at your option) any later version. 
# 
# Honeybee-REVIVE is distributed in the hope that it will be useful,
# but WITHOUT ANY WARRANTY; without even the implied warranty of 
# MERCHANTABILITY or FITNESS FOR A PARTICULAR PURPOSE. See the 
# GNU General Public License for more details.
# 
# For a copy of the GNU General Public License
# see <https://github.com/PH-Tools/honeybee_revive/blob/main/LICENSE>.
# 
# @license GPL-3.0+ <http://spdx.org/licenses/GPL-3.0+>
#
"""
Load a CO2-Reduction-Measure from the Honeybee-REVIVE Standards Library.
-
EM OCtober 1, 2024
    Args:
        _measuere_names: (list[str]) The name or names of the Measures to search the 
            Standards library for.

    Returns:
        measures_: (list[CO2ReductionMeasure]) The Measures, if found.
"""

import scriptcontext as sc
import Rhino as rh
import rhinoscriptsyntax as rs
import ghpythonlib.components as ghc
import Grasshopper as gh

try:
    from ph_gh_component_io import gh_io
except ImportError as e:
    raise ImportError('\nFailed to import ph_gh_component_io:\n\t{}'.format(e))

try:
    from honeybee_revive_rhino import gh_compo_io
except ImportError as e:
    raise ImportError('\nFailed to import honeybee_revive_rhino:\n\t{}'.format(e))


# ------------------------------------------------------------------------------
import honeybee_revive_rhino._component_info_
reload(honeybee_revive_rhino._component_info_)

ghenv.Component.Name = "HB-REVIVE - Load REVIVE CO2-Measures from Standards Library"
DEV = honeybee_revive_rhino._component_info_.set_component_params(ghenv, dev=False)
if DEV:
    from honeybee_revive_rhino.gh_compo_io.standards import load_CO2_measure_from_standards as gh_compo_io
    reload(gh_compo_io)

# ------------------------------------------------------------------------------
# -- GH Interface
IGH = gh_io.IGH( ghdoc, ghenv, sc, rh, rs, ghc, gh )

# ------------------------------------------------------------------------------
gh_compo_interface = gh_compo_io.GHCompo_LoadCO2ReductionMeasure(
        IGH,
        _measure_names,
)
measures_ = gh_compo_interface.run()
for m in measures_:
    print(m)
# ---------- end load_revive_co2_measures_from_standards ----------
create_co2_reduction_measure = HBREVIVECreateCO2ReductionMeasure(name="HP Replace 3", measure_type=value_list, year="60", cost="8500", country_name="USA", labor_fraction="0.4")  # -> out, measure; inputs year: Int32
# ---------- create_co2_reduction_measure: Python ----------
#
# Honeybee-REVIVE: A Plugin for calculating Phius REVIVE using LadybugTools Honeybee-Energy Models
# 
# This component is part of the PH-Tools toolkit <https://github.com/PH-Tools>.
# 
# Copyright (c) 2024, PH-Tools and bldgtyp, llc <phtools@bldgtyp.com> 
# Honeybee-REVIVE is free software; you can redistribute it and/or modify 
# it under the terms of the GNU General Public License as published 
# by the Free Software Foundation; either version 3 of the License, 
# or (at your option) any later version. 
# 
# Honeybee-REVIVE is distributed in the hope that it will be useful,
# but WITHOUT ANY WARRANTY; without even the implied warranty of 
# MERCHANTABILITY or FITNESS FOR A PARTICULAR PURPOSE. See the 
# GNU General Public License for more details.
# 
# For a copy of the GNU General Public License
# see <https://github.com/PH-Tools/honeybee_revive/blob/main/LICENSE>.
# 
# @license GPL-3.0+ <http://spdx.org/licenses/GPL-3.0+>
#
"""
Create a new Phius-REVIVE CO2 Reduction Measure which can be applied to a
Honeybee Model. Note that a Honeybee Model can have several measures applied.
-
EM October 1, 2024
    Args:
        _name: (str) The name to give to the CO2-Reduction-Measure

        _measure_type: (CO2ReductionMeasureType) Input either:
            "1-PERFORMANCE"
            "2-NON_PERFORMANCE"
            
        _year: (int) The year

        _cost: (float) The cost of the measure.

        _kg_CO2: (float) The KG of CO2e reduced by the measure.

        _country_name: (str) The name of the country.

        _labor_fraction: (float) The percentage of the measure which is 
            related to labor, as opposed to material.

    Returns:
        measure_: (CO2ReductionMeasure) The new CO2-Reduction-Measure which can 
            be added to a Honeybee-Model.
"""

import scriptcontext as sc
import Rhino as rh
import rhinoscriptsyntax as rs
import ghpythonlib.components as ghc
import Grasshopper as gh

try:
    from ph_gh_component_io import gh_io
except ImportError as e:
    raise ImportError('\nFailed to import ph_gh_component_io:\n\t{}'.format(e))

try:
    from honeybee_revive_rhino import gh_compo_io
except ImportError as e:
    raise ImportError('\nFailed to import honeybee_revive_rhino:\n\t{}'.format(e))


# ------------------------------------------------------------------------------
import honeybee_revive_rhino._component_info_
reload(honeybee_revive_rhino._component_info_)
ghenv.Component.Name = "HB-REVIVE - Create CO2 Reduction Measure"
DEV = honeybee_revive_rhino._component_info_.set_component_params(ghenv, dev=False)
if DEV:
    from honeybee_revive_rhino.gh_compo_io.model import create_CO2_measure as gh_compo_io
    reload(gh_compo_io)

# ------------------------------------------------------------------------------
# -- GH Interface
IGH = gh_io.IGH( ghdoc, ghenv, sc, rh, rs, ghc, gh )

# ------------------------------------------------------------------------------
gh_compo_interface = gh_compo_io.GHCompo_CreateCO2ReductionMeasure(
        IGH,
        _name,
        _measure_type,
        _year,
        _cost,
        _kg_CO2,
        _country_name,
        _labor_fraction,
)
measure_ = gh_compo_interface.run()
print(measure_)
# ---------- end create_co2_reduction_measure ----------
add_co2_reduction_measures_to_model = HBREVIVEAddCO2ReductionMeasuresToModel(
    measures=flatten([load_revive_co2_measures_from_standards.measures, create_co2_reduction_measure.measure]),
    model=model.model)  # -> out, model; inputs measures: list
# ---------- add_co2_reduction_measures_to_model: Python ----------
#
# Honeybee-REVIVE: A Plugin for calculating Phius REVIVE using LadybugTools Honeybee-Energy Models
# 
# This component is part of the PH-Tools toolkit <https://github.com/PH-Tools>.
# 
# Copyright (c) 2024, PH-Tools and bldgtyp, llc <phtools@bldgtyp.com> 
# Honeybee-REVIVE is free software; you can redistribute it and/or modify 
# it under the terms of the GNU General Public License as published 
# by the Free Software Foundation; either version 3 of the License, 
# or (at your option) any later version. 
# 
# Honeybee-REVIVE is distributed in the hope that it will be useful,
# but WITHOUT ANY WARRANTY; without even the implied warranty of 
# MERCHANTABILITY or FITNESS FOR A PARTICULAR PURPOSE. See the 
# GNU General Public License for more details.
# 
# For a copy of the GNU General Public License
# see <https://github.com/PH-Tools/honeybee_revive/blob/main/LICENSE>.
# 
# @license GPL-3.0+ <http://spdx.org/licenses/GPL-3.0+>
#
"""
Add one or more Phius-REVIVE CO2-Reduction-Measures to a Honeybee-Model.
-
EM October 1, 2024
    Args:
        _measures: (list[Measures]) A list of all of the Phius-REVIVE 
            CO2-Reduction-Measures that you would like to add to the Honeybee-Model.
            
        _model: (Model) The Honeybee Model which you would like to add the 
            Phius-REVIVE CO2-Reduction-Measures to.

    Returns:
        model_: (Model) The Honeybee Model with the Phius-REVIVE 
            CO2-Reduction-Measures added to it.
"""

import scriptcontext as sc
import Rhino as rh
import rhinoscriptsyntax as rs
import ghpythonlib.components as ghc
import Grasshopper as gh

try:
    from ph_gh_component_io import gh_io
except ImportError as e:
    raise ImportError('\nFailed to import ph_gh_component_io:\n\t{}'.format(e))

try:
    from honeybee_revive_rhino import gh_compo_io
except ImportError as e:
    raise ImportError('\nFailed to import honeybee_revive_rhino:\n\t{}'.format(e))


# ------------------------------------------------------------------------------
import honeybee_revive_rhino._component_info_
reload(honeybee_revive_rhino._component_info_)
ghenv.Component.Name = "HB-REVIVE - Add CO2 Reduction Measures to Model"
DEV = honeybee_revive_rhino._component_info_.set_component_params(ghenv, dev=False)
if DEV:
    from honeybee_revive_rhino.gh_compo_io.model import add_CO2_measures_to_model as gh_compo_io
    reload(gh_compo_io)
    
# ------------------------------------------------------------------------------
# -- GH Interface
IGH = gh_io.IGH( ghdoc, ghenv, sc, rh, rs, ghc, gh )

# ------------------------------------------------------------------------------
gh_compo_interface = gh_compo_io.GHCompo_AddCO2ReductionMeasuresToModel(
        IGH,
        _measures,
        _model,
)
model_ = gh_compo_interface.run()
if model_: print(model_.properties.revive.co2_measures)
# ---------- end add_co2_reduction_measures_to_model ----------

# ----
# REVIVE | Config.
hb_revive_grid_regions = HBREVIVEGridRegions({"AZNMc | WECC Southwest": "AZNMc", "CAMXc | WECC California": "CAMXc", "ERCTc | ERCOT All": "ERCTc", "FRCCc | FRCC All": "FRCCc", "MROEc | MRO East": "MROEc", "MROWc | MRO West": "MROWc", "NEWEc | NPCC New England": "NEWEc", "NWPPc | WECC Northwest": "NWPPc", "NYSTc | New York State": "NYSTc", "RFCEc | RFC East": "RFCEc", "RFCMc | RFC Michigan": "RFCMc", "RFCWc | RFC West": "RFCWc", "RMPAc | WECC Rockies": "RMPAc", "SPNOc | SPP North": "SPNOc", "SPSOc | SPP South": "SPSOc", "SRMVc | SERC Mississippi Valley": "SRMVc", "SRMWc | SERC Midwest": "SRMWc", "SRSOc | SERC South": "SRSOc", "SRTVc | SERC Tennessee Valley": "SRTVc", "SRVCc | SERC Virginia/Carolina": "SRVCc"}, selected="SPNOc | SPP North")
hb_revive_country = HBREVIVECountry({"CANADA", "CHINA", "FRANCE", "GERMANY", "INDIA", "IRELAND", "ITALY", "JAPAN", "SOUTH KOREA", "MALAYSIA", "MEXICO", "SWITZERLAND", "TAIWAN", "UNITED KINGDOM", "USA", "VIETNAM"}, selected="USA")
set_model_properties = HBREVIVESetModelProperties(
    country_name=hb_revive_country,
    cambium_grid_region=hb_revive_grid_regions,
    hb_model=add_co2_reduction_measures_to_model.model)  # -> out, hb_model; inputs analysis_duration: Int32
# ---------- set_model_properties: Python ----------
#
# Honeybee-REVIVE: A Plugin for calculating Phius REVIVE using LadybugTools Honeybee-Energy Models
# 
# This component is part of the PH-Tools toolkit <https://github.com/PH-Tools>.
# 
# Copyright (c) 2024, PH-Tools and bldgtyp, llc <phtools@bldgtyp.com> 
# Honeybee-REVIVE is free software; you can redistribute it and/or modify 
# it under the terms of the GNU General Public License as published 
# by the Free Software Foundation; either version 3 of the License, 
# or (at your option) any later version. 
# 
# Honeybee-REVIVE is distributed in the hope that it will be useful,
# but WITHOUT ANY WARRANTY; without even the implied warranty of 
# MERCHANTABILITY or FITNESS FOR A PARTICULAR PURPOSE. See the 
# GNU General Public License for more details.
# 
# For a copy of the GNU General Public License
# see <https://github.com/PH-Tools/honeybee_revive/blob/main/LICENSE>.
# 
# @license GPL-3.0+ <http://spdx.org/licenses/GPL-3.0+>
#
"""
Set the Phius-REVIVE ADORB calculation parameters for the Honeybee-Model.
-
EM October 1, 2024
    Args:
        _country_name: (str) The name of the Country the model is located in.

        _cambium_grid_region: (str) Pass in either the name of the Cambium Grid-Region you 
            would like to use (ie: 'AZNMc', etc..) or the filepath to a Cambium Grid-Region
            JSON file that you would like to use for the REVIVE ADORB analysis.
            
        _analysis_duration: (int) The number of years to run the ADORB analysis for.

        _envelope_labor_cost_fraction: (float) The percentage of the envelope cost
            which is related to labor, as opposed to materials.

        _hb_model: (Model) The Honeybee Model to set the REVIVE properties on.

    Returns:
        hb_model_: (Model) The Honeybee Model with the REVIVE properties set.
"""

import scriptcontext as sc
import Rhino as rh
import rhinoscriptsyntax as rs
import ghpythonlib.components as ghc
import Grasshopper as gh

try:
    from ph_gh_component_io import gh_io
except ImportError as e:
    raise ImportError('\nFailed to import ph_gh_component_io:\n\t{}'.format(e))

try:
    from honeybee_revive_rhino import gh_compo_io
except ImportError as e:
    raise ImportError('\nFailed to import honeybee_revive_rhino:\n\t{}'.format(e))


# ------------------------------------------------------------------------------
import honeybee_revive_rhino._component_info_
reload(honeybee_revive_rhino._component_info_)
ghenv.Component.Name = "HB-REVIVE - Set Model Properties"
DEV = honeybee_revive_rhino._component_info_.set_component_params(ghenv, dev=False)
if DEV:
    from honeybee_revive_rhino.gh_compo_io.model import set_model_properties as gh_compo_io
    reload(gh_compo_io)
    
# ------------------------------------------------------------------------------
# -- GH Interface
IGH = gh_io.IGH( ghdoc, ghenv, sc, rh, rs, ghc, gh )

# ------------------------------------------------------------------------------
gh_compo_interface = gh_compo_io.GHCompo_SetModelProperties(
        IGH,
        _country_name,
        _cambium_grid_region,
        _analysis_duration,
        _envelope_labor_cost_fraction,
        _hb_model,
)
hb_model_ = gh_compo_interface.run()
print hb_model_
# ---------- end set_model_properties ----------

file_path = FilePath("/Users/em/Dropbox/bldgtyp-00/00_PH_Tools/honeybee_REVIVE_grasshopper/tests/simulation_files/")

# ----
# ADORB Annual Simulation
file_path_2 = FilePath("/Users/em/Dropbox/bldgtyp-00/00_PH_Tools/honeybee_REVIVE_grasshopper/tests/weather_files/USA_IL_Chicago-Midway.AP.725340_TMY3.epw")
run = BooleanToggle(False)
modeltoosm = HBModelToOSM(model=set_model_properties.hb_model, epw_file=file_path_2, folder=file_path, write=run, run=run)  # -> out, jsons, osw, osm, idf, sql, zsz, rdd, html; plug-in component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

# ----
# Calc. ADPOB
run_2 = BooleanToggle(False)
calculate_adorb_costs = HBREVIVECalculateADORBCosts(folder=file_path, sql_path=modeltoosm.sql, hb_model=set_model_properties.hb_model, run=run_2)  # -> out, ADORB_costs, csv_results_file, tables
# ---------- calculate_adorb_costs: Python ----------
#
# Honeybee-REVIVE: A Plugin for calculating Phius REVIVE using LadybugTools Honeybee-Energy Models
# 
# This component is part of the PH-Tools toolkit <https://github.com/PH-Tools>.
# 
# Copyright (c) 2024, PH-Tools and bldgtyp, llc <phtools@bldgtyp.com> 
# Honeybee-REVIVE is free software; you can redistribute it and/or modify 
# it under the terms of the GNU General Public License as published 
# by the Free Software Foundation; either version 3 of the License, 
# or (at your option) any later version. 
# 
# Honeybee-REVIVE is distributed in the hope that it will be useful,
# but WITHOUT ANY WARRANTY; without even the implied warranty of 
# MERCHANTABILITY or FITNESS FOR A PARTICULAR PURPOSE. See the 
# GNU General Public License for more details.
# 
# For a copy of the GNU General Public License
# see <https://github.com/PH-Tools/honeybee_revive/blob/main/LICENSE>.
# 
# @license GPL-3.0+ <http://spdx.org/licenses/GPL-3.0+>
#
"""
Calculate the Phius-REVIVE ADORB costs for the Honeybee-Model.
-
EM October 1, 2024
    Args:

        _name_: (str) An optional variant name to be used for all of the output 
            files. If none is passed, will use the Model's display_name

        _folder_: (str) An optional path to the folder you would like to save
            the output files to. If none is passed, will use the default Honeybee
            simulation path:
            - MacOS > ./Users/{you}/simulatiion/...
            - Windows > someplace...

        _sql_path: (str) The path to the EnergyPlus results SQL file generated by Honeybee-Energy.

        _hb_model: (Model) The Honeybee-Model to calculate the Phius REVIVE ADORB Costs for.
        
        _run: (bool) Set to True to run the calculation.
            
    Returns:
        ADORB_Costs_: .....

        csv_results_file_: That path to the output CSV file with the full ADORB cost breakdown.

        tables_: The path to the output folder with the detailed table-views from the 
            ADORB calculation.
"""

import scriptcontext as sc
import Rhino as rh
import rhinoscriptsyntax as rs
import ghpythonlib.components as ghc
import Grasshopper as gh

try:
    from ph_gh_component_io import gh_io
except ImportError as e:
    raise ImportError('\nFailed to import ph_gh_component_io:\n\t{}'.format(e))

try:
    from honeybee_revive_rhino import gh_compo_io
except ImportError as e:
    raise ImportError('\nFailed to import honeybee_revive_rhino:\n\t{}'.format(e))


# ------------------------------------------------------------------------------
import honeybee_revive_rhino._component_info_
reload(honeybee_revive_rhino._component_info_)
ghenv.Component.Name = "HB-REVIVE - Calculate ADORB Costs"
DEV = honeybee_revive_rhino._component_info_.set_component_params(ghenv, dev=False)
if DEV:
    from honeybee_revive_rhino.gh_compo_io.adorb import calc_ADORB_costs as gh_compo_io
    reload(gh_compo_io)
    

# ------------------------------------------------------------------------------
# -- GH Interface
IGH = gh_io.IGH( ghdoc, ghenv, sc, rh, rs, ghc, gh )

# ------------------------------------------------------------------------------
gh_compo_interface = gh_compo_io.GHCompo_CalculateADORBCost(
        DEV,
        IGH,
        _name_, 
        _folder_,
        _sql_path,
        _hb_model,
        _run,
)
csv_results_file_, tables_ = gh_compo_interface.run()
# ---------- end calculate_adorb_costs ----------
panel_8 = Panel(calculate_adorb_costs.csv_results_file)
panel_9 = Panel(calculate_adorb_costs.tables)
panel_10 = Panel(calculate_adorb_costs.out)

panel_11 = Panel(file_path)

# ==== cluster Cluster
hb_objs = ClusterInput()
facesbytype = HBFacesByType(hb_objs=hb_objs)  # -> walls, interior_walls, roofs, ceilings, exterior_floors, interior_floors, air_walls, apertures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; plug-in component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
vizquick = HBVisualizeQuick(hb_objs=flatten(facesbytype.roofs))  # -> geo; plug-in component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
unit_z = UnitZ(Factor=1)
move = Move(Geometry=vizquick, Motion=unit_z)  # -> Geometry, Transform
geometry = ClusterOutput(move.Geometry)
